# Grasshopper definition Offload_Solid_GitHub.ghx (Grasshopper 1.0.8)

brep_base = GetGeometry(AnnotationTypeFilter=3966, AtLeast=1, AtMost=1, DeleteInput=False, Filter=1074081855, TreeAccess=False)
spheres = GetGeometry(AnnotationTypeFilter=3966, AtLeast=1, AtMost=1, DeleteInput=False, Filter=1074081855, TreeAccess=True)
solid_difference = SolidDifference(BrepsA=brep_base, BrepsB=spheres)
panel = Panel(solid_difference)
context_bake = ContextBake(Content=solid_difference)
concatenate = Concatenate(FragmentA="The body is ", FragmentB=panel)
context_print = ContextPrint(Text=concatenate)
