# Grasshopper definition Offload_Solid_GitHub_2.ghx (Grasshopper 1.0.8)

brep_base_gg = GetGeometry(AnnotationTypeFilter=3966, AtLeast=1, AtMost=1, DeleteInput=False, Filter=1074081855, TreeAccess=False)
spheres_gg = GetGeometry(AnnotationTypeFilter=3966, AtLeast=1, AtMost=1, DeleteInput=False, Filter=1074081855, TreeAccess=True)
solid_difference = SolidDifference(BrepsA=brep_base_gg, BrepsB=spheres_gg)
panel = Panel(solid_difference)
context_bake = ContextBake(Results_Git=solid_difference)
concatenate = Concatenate(FragmentA="The body is ", FragmentB=panel)
context_print = ContextPrint(Text_GitHubTest=concatenate)
