# Grasshopper definition hops_test.gh (Grasshopper 1.0.8)

base = GetGeometry(AnnotationTypeFilter=3966, AtLeast=1, AtMost=1, DeleteInput=False, Filter=1074081855, TreeAccess=False)
holes = GetGeometry(AnnotationTypeFilter=3966, AtLeast=1, AtMost=1, DeleteInput=False, Filter=1074081855, TreeAccess=False)
solid_difference = SolidDifference(BrepsA=base, BrepsB=holes)
context_bake = ContextBake(Content=solid_difference)
