# Grasshopper definition stent github.ghx (Grasshopper 1.0.8)

unit_x = UnitX(Factor=1)
yz_plane = YZPlane(Origin=Point(0, 0, 0))
number_slider = Slider(20.5, range=0..100)
move = Move(Geometry=yz_plane, Motion=unit_x)  # -> Geometry, Transform
construct_point = ConstructPoint(XCoordinate=Slider(-11, range=-50..50), YCoordinate=0, ZCoordinate=0)
yz_plane_2 = YZPlane(Origin=construct_point)
python_3_script = Python3Script(
    a=yz_plane,
    b=move.Geometry,
    p=Slider(11.7, range=0..100),
    r0=number_slider,
    r1=number_slider,
    t=Slider(5.9, range=0..100))  # -> out, a; inputs a: Point3d, b: Point3d
# ---------- python_3_script: Python ----------
import rhinoscriptsyntax as rs

a = rs.AddSpiral(a,b,p,t,r0,r1)
# ---------- end python_3_script ----------
unit_x_2 = UnitX(Factor=Slider(-13, range=-50..50))
cylinder = Cylinder(Base=yz_plane_2, Radius=Slider(20.5, range=0..100), Length=Slider(80, range=0..100))
move_2 = Move(Geometry=python_3_script.a, Motion=unit_x_2)  # -> Geometry, Transform
yz_plane_3 = YZPlane(Origin=Point(0, 0, 0))
rotate = Rotate(Geometry=move_2.Geometry, Angle=degrees(Slider(17.75, range=0..20)), Plane=yz_plane_3)  # -> Geometry, Transform
number_slider_2 = Slider(12.725, range=0..100)
divide_distance = DivideDistance(Curve=python_3_script.a, Distance=number_slider_2)  # -> Points, Tangents, Parameters
divide_distance_2 = DivideDistance(Curve=rotate.Geometry, Distance=number_slider_2)  # -> Points, Tangents, Parameters
brep = Brep(cylinder)
brep_closest_point = BrepClosestPoint(Point=divide_distance.Points, Brep=brep)  # -> Point, Normal, Distance
brep_closest_point_2 = BrepClosestPoint(Point=divide_distance_2.Points, Brep=brep)  # -> Point, Normal, Distance
plane_normal = PlaneNormal(Origin=brep_closest_point.Point, ZAxis=brep_closest_point.Normal)
plane_normal_2 = PlaneNormal(Origin=brep_closest_point_2.Point, ZAxis=brep_closest_point_2.Normal)
weave = Weave(Pattern=[0, 1], Stream0=plane_normal, Stream1=plane_normal_2, NullGaps=False)
radius = Slider(0.25, range=0..1)
polyline = PolyLine(Vertices=weave, Closed=False)
fillet = Fillet(Curve=polyline, Radius=Slider(1, range=0..10))
pipe = Pipe(Curve=fillet, Radius=radius, Caps=0, FitRail=False)
